% Simulink data dictionary vehicle_params.sldd

vehicle = struct(
  ms=12487,
  muf=706,
  mur=1000,
  m=14193,
  Ixx=24201,
  Ixz=4200,
  Izz=34917,
  h=0.83,
  hu=0.53,
  rf=1.15,
  rr=1.15,
  lf=1.95,
  lr=1.54,
  w=3.49,
  lw=0.93,
  kf=380000,
  kr=684000,
  bf=100000,
  br=100000,
  ktf=2060000,
  ktr=3337000,
  Cf=582000,
  Cr=783000,
  tAf=2.4076,
  tBf=0.6593,
  cf=0.8931,
  tAr=2.8629,
  tBr=0.4113,
  cr=0.7651,
  kAO_f=10730,
  kAO_r=15480,
  Df=32,
  Dr=34,
  mu=1,
  g=9.81,
  v=13.88889,
  SSF=1.120482,
  name="Single Unit Heavy Vehicle (Gaspar 2004 / Vu 2016)",
  reference="Gaspar et al. (2004), Vu et al. (2016)",
  dof=14)

MAR = struct(f=struct(phi=85413.58, phi_u=-311909.2), r=struct(phi=124554.5, phi_u=-866975.7))

C_ativo = Simulink.Parameter([1 0 0 0 0 0
 0 1 0 0 0 0
 0 0 1 0 0 0
 0 0 0 1 0 0
 0 0 0 0 1 0
 0 0 0 0 0 1])

D_ativo = Simulink.Parameter(repmat(0, 6, 4))

A_passive = Simulink.Parameter([-0 -1 0.1593792 -0 -3.223437 -5.239126
 -0 -2.023954e-17 0.5104787 -0 -10.32441 -16.78049
 0 2.138241e-33 -1.253589e-16 1 -8.982497e-16 -2.331317e-15
 0 -1.682629e-16 4.243901 0 -85.83268 -139.5058
 -0 -2.014012e-18 4.667701 2 -21.51855 -0.4459137
 -0 -3.233922e-18 8.104759 2 -0.3886032 -32.22384])

B_passive = Simulink.Parameter([7.055416e-06 6.397358e-06; 6.683882e-05 -3.52202e-05; 2.220446e-21 -1.110223e-21; 9.138357e-05 7.3861e-05; 1.21005e-05 5.444934e-07; 8.505696e-07 1.227124e-05])

C_passive = Simulink.Parameter([1 0 0 0 0 0
 0 1 0 0 0 0
 0 0 1 0 0 0
 0 0 0 1 0 0
 0 0 0 0 1 0
 0 0 0 0 0 1])

D_passive = Simulink.Parameter(repmat(0, 6, 2))
PID_params = struct(Kp=23.15, Ki=10.2, Kd=5.4, Tm_max=15000)

LQR_params = struct(
  K=repmat(0, 2, 6),
  Q=[10000000000 0 0 0; 0 50000000 0 0; 0 0 20000000 0; 0 0 0 20000000],
  R=[0.01 0; 0 0.01],
  T=[0 0 1 0 0 0
   0 0 0 1 0 0
   0 0 0 0 1 0
   0 0 0 0 0 1])

ARB_Mode = Simulink.Parameter(2)

A_ativo = Simulink.Parameter([-0 -1 0.2231309 -0 -4.512812 -7.334776
 -0 2.598029e-17 0.5104787 -0 -10.32441 -16.78049
 0 -1.660034e-33 -1.253589e-16 1 -8.982497e-16 -2.331317e-15
 0 2.15989e-16 4.243901 0 -85.83268 -139.5058
 -0 6.076595e-18 4.667701 2 -21.51855 -0.4459137
 -0 1.125123e-18 8.104759 2 -0.3886032 -32.22384])

B_ativo = Simulink.Parameter([9.877583e-06 8.956301e-06 4.389191e-06 6.583787e-06
 6.683882e-05 -3.52202e-05 1.004159e-05 1.506238e-05
 -2.220446e-21 -1.110223e-21 -2.220446e-21 -4.440892e-21
 9.138357e-05 7.3861e-05 8.348146e-05 0.0001252222
 1.21005e-05 5.444934e-07 2.668385e-07 1.040026e-05
 8.505696e-07 1.227124e-05 1.037796e-05 1.056694e-05])

ChassisStatesBus = Simulink.Bus()
  X: double
  Y: double
  Z: double
  phi: double
  theta: double
  psi: double
  vx: double
  vy: double
  vz: double
  p: double
  q: double
  r: double

TireForcesBus = Simulink.Bus()
  Fx_fl: double
  Fy_fl: double
  Fz_fl: double
  Mz_fl: double
  Fx_fr: double
  Fy_fr: double
  Fz_fr: double
  Mz_fr: double
  Fx_rl: double
  Fy_rl: double
  Fz_rl: double
  Mz_rl: double
  Fx_rr: double
  Fy_rr: double
  Fz_rr: double
  Mz_rr: double

SuspensionBus = Simulink.Bus()
  z_us_fl: double
  dz_us_fl: double
  Fs_fl: double
  z_us_fr: double
  dz_us_fr: double
  Fs_fr: double
  z_us_rl: double
  dz_us_rl: double
  Fs_rl: double
  z_us_rr: double
  dz_us_rr: double
  Fs_rr: double

susp_params = struct(K_sf=75000, C_sf=5000, K_sr=70000, C_sr=4000, K_t=175500, m_uf=80, m_ur=110)
pacejka_params = struct(pCy1=1.3, pDy1=1, pEy1=-0.5, pKy1=-20, pHy1=0, pVy1=0, pDy2=0, pEy2=0)