% Simulink data dictionary gaspar_params.sldd

m_s = 12487
m_uf = 706
m_ur = 1000
m = 14193
I_xx = 24201
I_zz = 34917
I_xz = 4200
h = 1.15
h_uf = 0.53
h_ur = 0.53
h_r = 0.83
l_f = 1.95
l_r = 1.54
l_w = 0.93
K_sf = 380000
K_sr = 684000
C_sf = 100000
C_sr = 100000
K_tf = 2060000
K_tr = 3337000
C_alpha_f = 582000
C_alpha_r = 783000
K_arf = 10730
K_arr = 15480
g = 9.81